# Grasshopper definition keycap.gh (Grasshopper 1.0.8)
# plug-ins: RhinoCodePluginGH, Isopod, LunchBox, eleFront

xy = XYPlane(Origin=Point(0, 0, 0))
base_plane = EleFrontDataDescription(xy, ShiftDepth=0, isNameSet=True)

base_plane_2 = EleFrontDataDescription(base_plane, ShiftDepth=0, isNameSet=False)
トップ底面高さ = Panel("0")
トップ表面高さ = Panel("4")
merge = Merge(Data1=トップ底面高さ, Data2=トップ表面高さ)
Z = UnitZ(Factor=merge)
move = Move(Geometry=base_plane_2, Motion=Z)  # -> Geometry, Transform

基本の幅 = Panel("16.5")
トップの基本厚さ = Panel("2")
抜き角度 = Slider(0, range=0..5)
tan = Tangent(Value=degrees(抜き角度))
multiplication = Multiplication(A=トップの基本厚さ, B=tan)
panel = EleFrontDataDescription(基本の幅, ShiftDepth=0, isNameSet=False)
subtraction = Subtraction(A=panel, B=multiplication)
merge_2 = Merge(Data1=panel, Data2=subtraction)
expression = Expression(x=merge_2, Expression="Format(\"{0} To {1}\", -x/2, x/2)")

コーナーフィレット距離 = Slider(1.2, range=0..3)

base_plane_3 = EleFrontDataDescription(base_plane, ShiftDepth=0, isNameSet=False)
expression_2 = Expression(x="1.25", Expression="Format(\"{0} To {1}\", -x/2, x/2)")
expression_3 = Expression(x="4.2", Expression="Format(\"{0} To {1}\", -x/2, x/2)")
merge_3 = Merge(Data1=expression_2, Data2=expression_3)
rev = ReverseList(List=merge_3)
base_plane_4 = EleFrontDataDescription(base_plane_3, ShiftDepth=0, isNameSet=False)
entwine = Entwine(Branch00=merge_3, Branch01=rev, FlattenInputs=True)
item = ListItem(List=entwine, Index=0, Wrap=True)  # -> Item, Item1
panel_2 = Panel("""5.5
5.6""")
expression_4 = Expression(x=panel_2, Expression="x/2")
rectangle = Rectangle(Plane=base_plane_4, XSize=item.Item, YSize=item.Item1, Radius=0)  # -> flatten(Rectangle), Length
cir = Circle(Plane=base_plane_4, Radius=expression_4)  # -> graft(Circle)
runion = RegionUnion(Curves=rectangle.Rectangle)
crossref = CrossReference(ListA=cir, ListB=runion, CrossMode=1)  # -> ListA, ListB
merge_4 = Merge(Data1=crossref.ListA, Data2=crossref.ListB)  # -> simplify(Result)
bang = ExplodeTree(Data=merge_4)  # -> Branch0, Branch1
Z_2 = UnitZ(Factor="4.1")
move_2 = Move(Geometry=bang.Branch1, Motion=Z_2)  # -> Geometry, Transform
merge_5 = Merge(Data1=bang.Branch0, Data2=move_2.Geometry)
flip = FlipMatrix(Data=merge_5)
loft = Loft(Curves=flip, Options={Adjust=False, Closed=False, LoftEnds=0, LoftSimp=0, LoftType=0, Rebuild=10, Refit=0.01})
cap = CapHoles(Brep=loft)  # -> flatten(Brep)
item_2 = ListItem(List=cap, Index=0, Wrap=True)  # -> Item, Item1
sdiff = SolidDifference(BrepsA=item_2.Item, BrepsB=item_2.Item1)
brep_socket = EleFrontDataDescription(sdiff, ShiftDepth=0, isNameSet=True)

トップ底面肉厚 = Slider(0.8, range=0..3)
トップの肉抜き高さ = Panel("3")
result = EleFrontDataDescription(multiplication, ShiftDepth=0, isNameSet=False)
result_2 = EleFrontDataDescription(multiplication, ShiftDepth=0, isNameSet=False)
expression_5 = Expression(x=コーナーフィレット距離, y=result, Expression="x-(y/2)")
expression_6 = Expression(x=コーナーフィレット距離, y=result_2, Expression="x-y")
merge_6 = Merge(Data1=コーナーフィレット距離, Data2=expression_5)

cylinder_radius = Slider(6.5, range=0..10)
cylinder_heigit = Slider(1.5, range=0..10)
item_3 = ListItem(List=move.Geometry, Index=0, Wrap=True)  # -> Item, Item1
cyl = Cylinder(Base=item_3.Item1, Radius=cylinder_radius, Length=cylinder_heigit)
cap_2 = CapHoles(Brep=cyl)
brep_top_cylinder = EleFrontDataDescription(cap_2, ShiftDepth=0, isNameSet=True)

トップの肉抜き高さ_2 = Panel("1.8")
トップ底面コーナーフィレット距離 = EleFrontDataDescription(expression_6, ShiftDepth=0, isNameSet=True)
コーナーフィレット距離_2 = EleFrontDataDescription(merge_6, ShiftDepth=0, isNameSet=True)
トップの肉抜き高さ_3 = EleFrontDataDescription(トップの肉抜き高さ, ShiftDepth=0, isNameSet=True)
トップ底面肉厚_2 = EleFrontDataDescription(トップ底面肉厚, ShiftDepth=0, isNameSet=True)
rectangle_2 = Rectangle(Plane=move.Geometry, XSize=expression, YSize=expression, Radius=0)  # -> Rectangle, Length
cylinder_heigit_2 = EleFrontDataDescription(cylinder_heigit, ShiftDepth=0, isNameSet=False)
merge_7 = Merge(Data1=トップ底面肉厚_2, Data2=トップの肉抜き高さ_2)
item_4 = ListItem(List=rectangle_2.Rectangle, Index=0, Wrap=True)  # -> Item, Item1
neg = Negative(Value=merge_7)
トップの肉抜き高さ_4 = EleFrontDataDescription(トップの肉抜き高さ_3, ShiftDepth=0, isNameSet=True)
offset = OffsetCurve(Curve=item_4.Item, Distance=neg, Corners=1)  # -> flatten(Curve)
Z_3 = UnitZ(Factor=トップの肉抜き高さ_4)
item_5 = ListItem(List=offset, Index=0, Wrap=True)  # -> Item, Item1
move_3 = Move(Geometry=item_5.Item1, Motion=Z_3)  # -> Geometry, Transform
merge_8 = Merge(Data1=item_5.Item, Data2=move_3.Geometry)

fillet = Fillet(Curve=rectangle_2.Rectangle, Radius=コーナーフィレット距離_2)
loft_2 = Loft(Curves=fillet, Options={Adjust=False, Closed=False, LoftEnds=0, LoftSimp=0, LoftType=0, Rebuild=10, Refit=0.01})
cap_3 = CapHoles(Brep=loft_2)

fillet_2 = Fillet(Curve=merge_8, Radius=トップ底面コーナーフィレット距離)
loft_3 = Loft(Curves=merge_8, Options={Adjust=False, Closed=False, LoftEnds=0, LoftSimp=0, LoftType=0, Rebuild=10, Refit=0.01})
cap_4 = CapHoles(Brep=loft_3)

sdiff_2 = SolidDifference(BrepsA=cap_3, BrepsB=cap_4)
brep_top = EleFrontDataDescription(sdiff_2, ShiftDepth=0, isNameSet=True)

brep_top_cylinder_2 = EleFrontDataDescription(brep_top_cylinder, ShiftDepth=0, isNameSet=False)

number_slider = Slider(1, range=0..10)  # disabled
number_slider_2 = Slider(2, range=0..10)  # disabled
number_slider_3 = Slider(4, range=0..10)  # disabled
number_slider_4 = Slider(5, range=0..10)  # disabled
merge_9 = Merge(Data1=number_slider, Data2=number_slider_2, Data3=number_slider_3, Data4=number_slider_4)  # disabled

コーナーフィレット距離_3 = Slider(0.25, range=0..0.5)  # disabled
コーナーフィレット距離_4 = Slider(0.05, range=0..0.1)  # disabled
コーナーフィレット距離_5 = Slider(0.1, range=0..0.1)  # disabled
コーナーフィレット距離_6 = Slider(0.1, range=0..0.1)  # disabled
merge_10 = Merge(Data1=コーナーフィレット距離_3, Data2=コーナーフィレット距離_4, Data3=コーナーフィレット距離_5, Data4=コーナーフィレット距離_6)  # disabled

brep_top_2 = EleFrontDataDescription(brep_top, ShiftDepth=0, isNameSet=False)  # disabled
filedge = FilletEdge(Shape=brep_top_2, Blend=0, Metric=0, Edges=merge_9, Radii=merge_10)  # disabled
brep_top_3 = EleFrontDataDescription(filedge, ShiftDepth=0, isNameSet=True)  # disabled

brep_top_cylinder_3 = EleFrontDataDescription(brep_top_cylinder, ShiftDepth=0, isNameSet=False)

custom_mesh_settings = SettingsCustom(
    StitchSeams=Toggle(True),
    SimplePlanes=Toggle(False),
    Refine=Toggle(False),
    MinCount=16,
    MaxCount="0",
    AspectRatio="1",
    MaxDistance="0.1",
    MaxAngle="3",
    MinEdge=0,
    MaxEdge="0.1")

brep_top_cylinder_4 = EleFrontDataDescription(brep_top_cylinder_2, ShiftDepth=0, isNameSet=False)  # disabled
mesh = MeshBrep(Brep=brep_top_cylinder_4, Settings=custom_mesh_settings)  # disabled
meshsolidsdf = MeshSolidSDF(Mesh=mesh)  # -> out, a; inputs Mesh: Mesh; disabled
# ---------- meshsolidsdf: C# ----------
// Grasshopper Script Instance
#region Usings
#r "Isopod.dll"
using Isopod;
using System;
using System.Linq;
using System.Collections;
using System.Collections.Generic;
using System.Drawing;

using Rhino;
using Rhino.Geometry;

using Grasshopper;
using Grasshopper.Kernel;
using Grasshopper.Kernel.Data;
using Grasshopper.Kernel.Types;
#endregion

public class Script_Instance : GH_ScriptInstance
{
    #region Notes
    /* 
      Members:
        RhinoDoc RhinoDocument
        GH_Document GrasshopperDocument
        IGH_Component Component
        int Iteration

      Methods (Virtual & overridable):
        Print(string text)
        Print(string format, params object[] args)
        Reflect(object obj)
        Reflect(object obj, string method_name)
    */
    #endregion

    private void RunScript(Mesh Mesh, ref object a)
    {
        a = new MeshSolidSDF(Mesh);
    }

  public class MeshSolidSDF : Field
  {
    Mesh m;        
    public MeshSolidSDF(Mesh m)
    {      
      this.m = m;     
      Point3d test = m.ClosestPoint(Point3d.Origin);//to ensure the RTRee is built
    }
    public override double ValueAt(Point3d P)
    {      
      bool inside = m.IsPointInside(P,0.001,false);
      double d = P.DistanceTo(m.ClosestPoint(P)); 
      return inside?-d:d;            
    }
  }
}
# ---------- end meshsolidsdf ----------

brep_top_4 = EleFrontDataDescription(brep_top_3, ShiftDepth=0, isNameSet=True)  # disabled
コーナーフィレット距離_7 = Slider(0.1, range=0..0.5)
コーナーフィレット距離_8 = Slider(0.1, range=0..0.1)
コーナーフィレット距離_9 = Slider(0.1, range=0..0.1)
コーナーフィレット距離_10 = Slider(0.1, range=0..0.1)
コーナーフィレット距離_11 = Slider(0.15, range=0..0.2)
コーナーフィレット距離_12 = Slider(0.1, range=0..0.1)

brep_top_cylinder_5 = EleFrontDataDescription(brep_top_cylinder_3, ShiftDepth=0, isNameSet=False)
brep_top_5 = EleFrontDataDescription(brep_top, ShiftDepth=0, isNameSet=False)
merge_11 = Merge(Data1=brep_top_cylinder_5, Data2=brep_top_5)
sunion = SolidUnion(Breps=merge_11)

cylinder_heigit_3 = EleFrontDataDescription(cylinder_heigit_2, ShiftDepth=0, isNameSet=False)

merge_12 = Merge(Data1=brep_top_cylinder_4, Data2=brep_top_4)  # disabled
number_slider_5 = Slider(1.1, range=0..10)  # disabled
bbox = BoundingBox(Content=merge_12, Plane=PlaneXY(0, 0, 0), UnionBox=True)  # -> Box, Box_2; disabled
volume = Volume(Geometry=bbox.Box)  # -> Volume, Centroid; disabled
scale = Scale(Geometry=bbox.Box, Center=volume.Centroid, Factor=number_slider_5)  # -> Geometry, Transform; disabled

mesh_2 = MeshBrep(Brep=brep_top_4, Settings=custom_mesh_settings)  # disabled
number_slider_6 = Slider(1, range=0..1)  # disabled
number_slider_7 = Slider(30, range=0..100)  # disabled
subtraction_2 = Subtraction(A=cylinder_heigit_3, B=コーナーフィレット距離_11)
meshsolidsdf_2 = MeshSolidSDF(Mesh=mesh_2)  # -> out, a; inputs Mesh: Mesh; disabled; same code as meshsolidsdf
list = ValueList({"Fillet": 0, "Chamfer": 1, "Blend": 2}, selected="Fillet")
merge_13 = Merge(
    Data1=Slider(1, range=0..10),
    Data2=Slider(2, range=0..10),
    Data3=Slider(4, range=0..10),
    Data4=Slider(5, range=0..10),
    Data5=Slider(6, range=0..10),
    Data6=Slider(7, range=0..10),
    Data7=Slider(11, range=0..20),
    Data8=Slider(12, range=0..20),
    Data9=Slider(13, range=0..20),
    Data10=Slider(14, range=0..20),
    Data11=Slider(15, range=0..20),
    Data12=Slider(17, range=0..20),
    Data13=Slider(3, range=0..20),
    Data14=Slider(8, range=0..20),
    Data15=Slider(9, range=0..20),
    Data16=Slider(10, range=0..20))
merge_14 = Merge(
    Data1=コーナーフィレット距離_7,
    Data2=コーナーフィレット距離_8,
    Data3=コーナーフィレット距離_9,
    Data4=コーナーフィレット距離_9,
    Data5=コーナーフィレット距離_9,
    Data6=コーナーフィレット距離_9,
    Data7=コーナーフィレット距離_10,
    Data8=コーナーフィレット距離_10,
    Data9=コーナーフィレット距離_10,
    Data10=コーナーフィレット距離_10,
    Data11=subtraction_2,
    Data12=コーナーフィレット距離_11,
    Data13=コーナーフィレット距離_12,
    Data14=コーナーフィレット距離_12,
    Data15=コーナーフィレット距離_12,
    Data16=コーナーフィレット距離_12)
debrep = DeconstructBrep(Brep=sunion)  # -> Faces, Edges, Vertices
smoothunion = SmoothUnion(fa=meshsolidsdf.a, fb=meshsolidsdf_2.a, k=number_slider_6)  # -> out, a; inputs k: Double; disabled
# ---------- smoothunion: C# ----------
// Grasshopper Script Instance
#region Usings
#r "Isopod.gha"
using Isopod;
using System;
using System.Linq;
using System.Collections;
using System.Collections.Generic;
using System.Drawing;

using Rhino;
using Rhino.Geometry;

using Grasshopper;
using Grasshopper.Kernel;
using Grasshopper.Kernel.Data;
using Grasshopper.Kernel.Types;
#endregion

public class Script_Instance : GH_ScriptInstance
{
    #region Notes
    /* 
      Members:
        RhinoDoc RhinoDocument
        GH_Document GrasshopperDocument
        IGH_Component Component
        int Iteration

      Methods (Virtual & overridable):
        Print(string text)
        Print(string format, params object[] args)
        Reflect(object obj)
        Reflect(object obj, string method_name)
    */
    #endregion

    private void RunScript(object fa, object fb, double k, ref object a)
    {       
        a = new SmoothUnion(fa as IField,fb as IField,k);
    }

    public class SmoothUnion : Field 
  {    
    IField fa,fb;
    double k;

    public SmoothUnion(IField fa,IField fb,double k)
    {      
      this.k = k;
      this.fa = fa;
      this.fb = fb;
    }
    public override double ValueAt(Point3d P)
    {        
        return Utils.smoothUnion(fa.ValueAt(P),fb.ValueAt(P),k);        
    }
  } 
}
# ---------- end smoothunion ----------
panel_3 = Panel("1")  # disabled
filedge_2 = FilletEdge(Shape=sunion, Blend=list, Metric=0, Edges=merge_13, Radii=merge_14)
isomesh2 = IsoMesh2(Field=smoothunion.a, Box=scale.Geometry, Resolution=number_slider_7, RootFindingMaxSteps=panel_3)  # disabled
item_6 = ListItem(List=debrep.Edges, Index=Slider(3, range=0..100), Wrap=True)
brep_top_6 = EleFrontDataDescription(filedge_2, ShiftDepth=0, isNameSet=True)

brep_top_7 = EleFrontDataDescription(brep_top_6, ShiftDepth=0, isNameSet=False)  # disabled
debrep_2 = DeconstructBrep(Brep=brep_top_7)  # -> Faces, Edges, Vertices; disabled
panel_4 = Panel("5")  # disabled
cull_i = CullIndex(List=debrep_2.Faces, Indices=panel_4, Wrap=True)  # disabled
item_7 = ListItem(List=debrep_2.Faces, Index=panel_4, Wrap=True)  # disabled
number_slider_8 = Slider(0.2, range=0..1)  # disabled
コーナーフィレット距離_13 = EleFrontDataDescription(コーナーフィレット距離_11, ShiftDepth=0, isNameSet=False)  # disabled
expression_7 = Expression(x=コーナーフィレット距離_13, Expression="x*-2")  # disabled
neg_2 = Negative(Value=number_slider_8)  # disabled
Z_4 = UnitZ(Factor=neg_2)  # disabled
move_4 = Move(Geometry=item_7, Motion=Z_4)  # -> Geometry, Transform; disabled
offset_2 = OffsetCurve(Curve=move_4.Geometry, Distance=neg_2, Corners=1)  # disabled
darc = DeconstructArc(Arc=item_7)  # -> BasePlane, Radius, Angle; disabled
end = EndPoints(Curve=item_7)  # -> Start, End; disabled
end_2 = EndPoints(Curve=offset_2)  # -> Start, End; disabled
vec2pt = Vector2Pt(PointA=end.Start, PointB=darc.BasePlane, Unitize=False)  # -> Vector, Length; disabled
Z_5 = UnitZ(Factor=1)  # disabled
biarc = BiArc(StartPoint=end.Start, StartTangent=vec2pt.Vector, EndPoint=end_2.Start, EndTangent=vec2pt.Vector, Ratio=0.5)  # -> FirstArc, SecondArc, BiArc; disabled
line = LineSDL(Start=Z_5, Direction=Z_5, Length=Z_5)  # disabled
revsrf = Revolution(Curve=biarc.BiArc, Axis=line, Domain=Domain(0, 6.283185307))  # -> flatten(Surface); disabled
list_2 = EleFrontDataDescription(flatten(cull_i), ShiftDepth=0, isNameSet=False)  # disabled
merge_15 = Merge(Data1=revsrf, Data2=list_2)  # -> flatten(Result); disabled
join = BrepJoin(Breps=merge_15)  # -> Breps, Closed; disabled
cap_5 = CapHoles(Brep=join.Breps)  # disabled

number_slider_9 = Slider(0.5, range=0..1)  # disabled
neg_3 = Negative(Value=number_slider_9)  # disabled
Z_6 = UnitZ(Factor=neg_3)  # disabled

neg_4 = Negative(Value=Slider(0.3, range=0..1))
Z_7 = UnitZ(Factor=neg_4)

debrep_3 = DeconstructBrep(Brep=brep_top_6)  # -> Faces, Edges, Vertices; disabled
panel_5 = Panel("0")  # disabled
panel_6 = Panel("""1
4""")
cull_i_2 = CullIndex(List=debrep_3.Faces, Indices=panel_5, Wrap=True)  # disabled
item_8 = ListItem(List=debrep_3.Faces, Index=0, Wrap=True)  # disabled
join_2 = BrepJoin(Breps=cull_i_2)  # -> Breps, Closed; disabled
edges = BrepEdges(Brep=join_2.Breps)  # -> Naked, Interior, NonManifold; disabled
explode = Explode(Curve=edges.Naked, Recursive=True)  # -> Segments, Vertices; disabled
bang_2 = ExplodeTree(Data=explode.Segments)  # -> Branch0, Branch1; disabled
rev_2 = ReverseList(List=bang_2.Branch1)  # disabled
flip_2 = FlipCurve(Curve=rev_2)  # -> Curve, Flag; disabled
merge_16 = Merge(Data1=bang_2.Branch0, Data2=flip_2.Curve)  # disabled
flip_3 = FlipMatrix(Data=merge_16)  # disabled
loft_4 = Loft(Curves=flip_3, Options={Adjust=False, Closed=False, LoftEnds=0, LoftSimp=0, LoftType=0, Rebuild=10, Refit=0.01})  # disabled
merge_17 = Merge(Data1=join_2.Breps, Data2=loft_4)  # -> flatten(Result); disabled
join_3 = BrepJoin(Breps=merge_17)  # -> Breps, Closed; disabled

expression_8 = Expression(x="79.6", Expression="Format(\"{0} To {1}\", -x/2, x/2)")
expression_9 = Expression(x="143", Expression="Format(\"{0} To {1}\", -x/2, x/2)")
rectangle_3 = Rectangle(Plane=PlaneXY(0, 0, 0), XSize=expression_8, YSize=expression_9, Radius=0)  # -> Rectangle, Length

Z_8 = UnitZ(Factor=1)
X = UnitX(Factor=1)
Z_9 = UnitZ(Factor=1)
rot3d = Rotate3D(Angle=degrees("45"), Center=Point(0, 0, 0), Axis=Z_8)  # -> Geometry, Transform
rot3d_2 = Rotate3D(Angle=degrees("30"), Center=Point(0, 0, 0), Axis=X)  # -> Geometry, Transform
rot3d_3 = Rotate3D(Angle=degrees("-45"), Center=Point(0, 0, 0), Axis=Z_9)  # -> Geometry, Transform
merge_18 = Merge(Data1=rot3d.Transform, Data2=rot3d_2.Transform, Data3=rot3d_3.Transform)
comp = Compound(Transforms=merge_18)

trib = TrianglePanelsB(UDivisions=10, VDivisions=10)
rec_2pt = Rectangle2Pt(Plane=PlaneXY(0, 0, 0), PointA=Point(0, 0, 0), PointB=Point(17.5, 17.5, 0), Radius=0)  # -> Rectangle, Length
dgrid = DiamondGrid(Surface=rectangle_3.Rectangle, UDivisions=10, VDivisions=10)  # -> CornerPoint1, CornerPoint2, CornerPoint3, CornerPoint4, MidPoint, Normals
corner_point_1 = EleFrontDataDescription(dgrid.CornerPoint1, ShiftDepth=0, isNameSet=False)
corner_point_2 = EleFrontDataDescription(dgrid.CornerPoint2, ShiftDepth=0, isNameSet=False)
corner_point_3 = EleFrontDataDescription(dgrid.CornerPoint3, ShiftDepth=0, isNameSet=False)
corner_point_4 = EleFrontDataDescription(dgrid.CornerPoint4, ShiftDepth=0, isNameSet=False)
mid_point = EleFrontDataDescription(dgrid.MidPoint, ShiftDepth=0, isNameSet=False)
normals = EleFrontDataDescription(dgrid.Normals, ShiftDepth=0, isNameSet=False)

コーナーフィレット距離_14 = Slider(0.08, range=0..0.1)
brep_socket_2 = EleFrontDataDescription(brep_socket, ShiftDepth=0, isNameSet=False)
merge_19 = Merge(Data1=コーナーフィレット距離_14)

merge_20 = Merge(
    Data1=Slider(2, range=0..30),
    Data2=Slider(5, range=0..30),
    Data3=Slider(8, range=0..30),
    Data4=Slider(11, range=0..30),
    Data5=Slider(14, range=0..30),
    Data6=Slider(27, range=0..30),
    Data7=Slider(28, range=0..30),
    Data8=Slider(29, range=0..30),
    Data9=Slider(30, range=0..30),
    Data10=Slider(31, range=0..40),
    Data11=Slider(32, range=0..40),
    Data12=Slider(33, range=0..40),
    Data13=Slider(34, range=0..40),
    Data14=Slider(35, range=0..40),
    Data15=Slider(36, range=0..40),
    Data16=Slider(37, range=0..40),
    Data17=Slider(38, range=0..40))

lng = ListLength(List=merge_20)
dup = DuplicateData(Data=merge_19, Number=lng, Order=True)
filedge_3 = FilletEdge(Shape=brep_socket_2, Blend=0, Metric=0, Edges=merge_20, Radii=dup)
brep_socket_3 = EleFrontDataDescription(filedge_3, ShiftDepth=0, isNameSet=True)

brep_socket_4 = EleFrontDataDescription(brep_socket_3, ShiftDepth=0, isNameSet=False)

brep_top_8 = EleFrontDataDescription(brep_top_6, ShiftDepth=0, isNameSet=False)  # disabled
debrep_4 = DeconstructBrep(Brep=brep_top_8)  # -> Faces, Edges, Vertices; disabled
panel_7 = Panel("5")  # disabled
cull_i_3 = CullIndex(List=debrep_4.Faces, Indices=panel_7, Wrap=True)  # disabled
item_9 = ListItem(List=debrep_4.Faces, Index=panel_7, Wrap=True)  # disabled
darc_2 = DeconstructArc(Arc=item_9)  # -> BasePlane, Radius, Angle; disabled
pt = Point(darc_2.BasePlane)  # disabled
number_slider_10 = Slider(0, range=0..6)  # disabled
cylinder_heigit_4 = EleFrontDataDescription(cylinder_heigit_2, ShiftDepth=0, isNameSet=False)  # disabled
number_slider_11 = Slider(0.3, range=0..1)  # disabled
Z_10 = UnitZ(Factor=1)  # disabled
line_2 = LineSDL(Start=Z_10, Direction=Z_10, Length=Z_10)  # disabled
list_3 = EleFrontDataDescription(flatten(cull_i_3), ShiftDepth=0, isNameSet=False)  # disabled

end_3 = EndPoints(Curve=item_9)  # -> Start, End; disabled
vec2pt_2 = Vector2Pt(PointA=darc_2.BasePlane, PointB=end_3.Start, Unitize=False)  # -> Vector, Length; disabled
merge_21 = Merge(Data1=vec2pt_2.Vector, Data2=vec2pt_2.Vector)  # disabled

start = EleFrontDataDescription(end_3.Start, ShiftDepth=0, isNameSet=False)  # disabled
amp = Amplitude(Vector=vec2pt_2.Vector, Amplitude=number_slider_10)  # disabled
addition = Addition(A=Z_6, B=amp)  # disabled
move_5 = Move(Geometry=pt, Motion=addition)  # -> Geometry, Transform; disabled
start_2 = EleFrontDataDescription(start, ShiftDepth=0, isNameSet=False)  # disabled
merge_22 = Merge(Data1=move_5.Geometry, Data2=start_2)  # disabled
tancurve = TangentCurve(Vertices=merge_22, Tangents=merge_21, Blend=number_slider_11, Degree=3)  # -> Curve, Length, Domain; disabled
revsrf_2 = Revolution(Curve=tancurve.Curve, Axis=line_2, Domain=Domain(0, 6.283185307))  # -> flatten(Surface); disabled
merge_23 = Merge(Data1=revsrf_2, Data2=list_3)  # -> flatten(Result); disabled
join_4 = BrepJoin(Breps=merge_23)  # -> Breps, Closed; disabled
cap_6 = CapHoles(Brep=join_4.Breps)  # disabled

brep_top_9 = EleFrontDataDescription(brep_top_6, ShiftDepth=0, isNameSet=False)
debrep_5 = DeconstructBrep(Brep=brep_top_9)  # -> Faces, Edges, Vertices
cull_i_4 = CullIndex(List=debrep_5.Faces, Indices="8", Wrap=True)
item_10 = ListItem(List=debrep_5.Faces, Index="8", Wrap=True)
darc_3 = DeconstructArc(Arc=item_10)  # -> BasePlane, Radius, Angle
pt_2 = Point(darc_3.BasePlane)
Z_11 = UnitZ(Factor=1)
line_3 = LineSDL(Start=Z_11, Direction=Z_11, Length=Z_11)
list_4 = EleFrontDataDescription(flatten(cull_i_4), ShiftDepth=0, isNameSet=False)

end_4 = EndPoints(Curve=item_10)  # -> Start, End
vec2pt_3 = Vector2Pt(PointA=darc_3.BasePlane, PointB=end_4.Start, Unitize=False)  # -> Vector, Length
merge_24 = Merge(Data1=vec2pt_3.Vector, Data2=vec2pt_3.Vector)

start_3 = EleFrontDataDescription(end_4.Start, ShiftDepth=0, isNameSet=False)
amp_2 = Amplitude(Vector=vec2pt_3.Vector, Amplitude=Slider(3, range=0..6))
addition_2 = Addition(A=Z_7, B=amp_2)
move_6 = Move(Geometry=pt_2, Motion=addition_2)  # -> Geometry, Transform
start_4 = EleFrontDataDescription(start_3, ShiftDepth=0, isNameSet=False)
merge_25 = Merge(Data1=move_6.Geometry, Data2=start_4)
biarc_2 = BiArc(
    StartPoint=move_6.Geometry,
    StartTangent=vec2pt_3.Vector,
    EndPoint=start_4,
    EndTangent=vec2pt_3.Vector,
    Ratio=Slider(0.8, range=0..1))  # -> FirstArc, SecondArc, BiArc
revsrf_3 = Revolution(Curve=biarc_2.BiArc, Axis=line_3, Domain=Domain(0, 6.283185307))  # -> flatten(Surface)
merge_26 = Merge(Data1=revsrf_3, Data2=list_4)  # -> flatten(Result)
join_5 = BrepJoin(Breps=merge_26)  # -> Breps, Closed
cap_7 = CapHoles(Brep=join_5.Breps)

debrep_6 = DeconstructBrep(Brep=cap_7)  # -> Faces, Edges, Vertices
cull_i_5 = CullIndex(List=debrep_6.Faces, Indices=panel_6, Wrap=True)
cull_i_6 = CullIndex(List=debrep_6.Faces, Indices="1", Wrap=True)
join_6 = BrepJoin(Breps=cull_i_5)  # -> Breps, Closed
join_7 = BrepJoin(Breps=cull_i_6)  # -> Breps, Closed
edges_2 = BrepEdges(Brep=join_7.Breps)  # -> Naked, Interior, NonManifold
explode_2 = Explode(Curve=edges_2.Naked, Recursive=True)  # -> Segments, Vertices
bang_3 = ExplodeTree(Data=explode_2.Segments)  # -> _00000, _00010
rev_3 = ReverseList(List=bang_3._00010)
flip_4 = FlipCurve(Curve=rev_3)  # -> Curve, Flag
merge_27 = Merge(Data1=bang_3._00000, Data2=flip_4.Curve)
flip_5 = FlipMatrix(Data=merge_27)
loft_5 = Loft(Curves=flip_5, Options={Adjust=False, Closed=False, LoftEnds=0, LoftSimp=0, LoftType=0, Rebuild=10, Refit=0.01})
merge_28 = Merge(Data1=join_7.Breps, Data2=loft_5)  # -> flatten(Result)
join_8 = BrepJoin(Breps=merge_28)  # -> Breps, Closed
merge_29 = Merge(Data1=join_8.Breps, Data2=brep_socket_4)  # -> flatten(Result)
sunion_2 = SolidUnion(Breps=merge_29)
transform = Transform(Geometry=sunion_2, Transform=comp)
arrrec = RectangularArray(Geometry=sunion_2, Cell=rec_2pt.Rectangle, XCount=6, YCount=4)  # -> Geometry, Transform

swatch = ColourSwatch(SwatchColor=RGB(255, 255, 255))  # disabled
material = CreateMaterial(Diffuse=swatch, Specular=RGB(255, 255, 255), Emission=RGB(0, 0, 0), Transparency=0, Shine=0)  # disabled
preview = CustomPreview(Geometry=arrrec.Geometry, Material=material)  # disabled

bake = BakeObjects(Geometry=sunion_2, BakeName="cap", Bake=Toggle(True), createGroups=False)  # -> Message, Ghosts
